# Grasshopper definition 20181018_Point series.gh (Grasshopper 1.0.7)

c_script = CSharpScript(Maximum=Slider(40, range=0..100), Steps=Slider(40, range=0..100))  # -> out, A, B, C; inputs Maximum: Double, Steps: Int32
# ---------- c_script: C# ----------
    List<double> values = GetRange(Maximum, Steps);
    List<double> valuesY = new List<double>();

    for (int i = 0; i < values.Count; i++)
    {
      //take one value from values and assign it to val
      double val = values[i];

      //compute function for this value and assign it back to val
      val = ComputeFunction(val);

      //store the val in valuesY
      valuesY.Add(val);

      //all of that can be written as a single line of code:
      //valuesY.Add(ComputeFunction(values[i]));
    }

    //the list of points which we will add the points to
    List<Point3d> points = new List<Point3d>();

    //this loop will iterate each value from values
    for (int i = 0; i < values.Count; i++)
    {
      double thisx = values[i]; //getting the i-th value from values
      double thisy = valuesY[i]; //getting the i-th value from valuesY
      points.Add(new Point3d(thisx, thisy, 0)); //create the point and Add it to the list
    }

    A = values;
    B = valuesY;
    C = points;
# ---------- c_script: C# additional code ----------
  public double ComputeFunction(double x) {
    return Math.Sin(x);
  }

  //creates a range of numbers
  public List<double> GetRange(double Maximum, int Steps) {
    // 10
    // 3
    // 0, 3, 6, 9, 12....
    // 10/3 = 3.333333(3) <- step
    // 0, 3.33, 6.66 , 9.99999(9)

    List<double> list = new List<double>();
    double step = Maximum / Steps;

    for (double i = 0; i <= Maximum; i = i + step)
    {
      list.Add(i);
    }

    return list;
  }
# ---------- end c_script ----------
c_script_2 = CSharpScript()  # -> out, A
# ---------- c_script_2: C# ----------
    for (int i = 100; i >= 0; i = i - 10)
    {
      this.Print(i.ToString());
    }
# ---------- end c_script_2 ----------
panel = Panel(c_script_2.out)
