# Grasshopper definition 20181025_MDArray.gh (Grasshopper 1.0.7)

number_slider = Slider(83, range=0..100)
number_slider_2 = Slider(66, range=0..100)
c_script = CSharpScript(x=number_slider_2, y=number_slider)  # -> out, A; inputs x: Int32, y: Int32
# ---------- c_script: C# ----------
    Point3d[,] points = new Point3d[x, y];

    for (int i = 0; i < y; i++)
    {
      for (int j = 0; j < x; j++)
      {
        points[j, i] = new Point3d(j, i, 4 * Math.Sin(j/3.0) * Math.Cos(i/3.0));
      }
    }

    A = points;
# ---------- end c_script ----------
c_script_2 = CSharpScript(x=number_slider_2, y=number_slider)  # -> out, A; inputs x: Int32, y: Int32
# ---------- c_script_2: C# ----------
    List<List<Point3d>> points = new List<List<Point3d>>();
    List<Point3d> unordered = new List<Point3d> (); 
    
    for (int i = 0; i < y; i++)
    {
      List<Point3d> row = new List<Point3d>();

      for (int j = 0; j < x; j++)
      {
        row.Add(new Point3d(j, i, 4 * Math.Sin(j / 3.0) * Math.Cos(i / 3.0)));
      }

      points.Add(row);
      unordered.AddRange(row); 
    }

    A = unordered;
# ---------- end c_script_2 ----------
panel = Panel(c_script.A)
