# Grasshopper definition 20181101_MDArray.gh (Grasshopper 1.0.7)

number_slider = Slider(56, range=0..100)
number_slider_2 = Slider(67, range=0..100)
pt = Point(<point referenced from the Rhino model>)
c_script = CSharpScript(x=number_slider_2, y=number_slider, z=Slider(3.645, range=0..10), u=pt)  # -> out, A; inputs x: Int32, y: Int32, z: Double, u: Point3d
# ---------- c_script: C# ----------
    double distance;
    double minDistance=x/2;
    double maxDistance=x/2;

    Point3d[,] points = new Point3d[x, y];

    for (int i = 0; i < y; i++)
    {
      for (int j = 0; j < x; j++)
      {
        //double mappedDistance;
        distance = Math.Sqrt(Math.Pow((u.X - j), 2) + Math.Pow((u.Y - i), 2));
        if(minDistance>distance){
          minDistance = distance;
        }
        if(maxDistance < distance){
          maxDistance = distance;
        }
        double mappedDistance = mapNumber(distance, minDistance, maxDistance, 5, 0);
        this.Print(mappedDistance.ToString());
        points[j, i] = new Point3d(j, i, mappedDistance * z * Math.Sin(j / 4.0) * Math.Cos(i / 4.0));
      }
    }

    A = points;
# ---------- c_script: C# additional code ----------
  public double mapNumber(double value, double sourceStart, double sourceEnd, int targetStart, int targetEnd){

    return(value - sourceStart) / (sourceEnd - sourceStart) * (targetEnd - targetStart) + targetStart;

  }
# ---------- end c_script ----------
srfgrid = SurfaceFromPoints(Points=c_script.A, UCount=number_slider_2, Interpolate=number_slider)
panel = Panel(c_script.out)
