# Grasshopper definition 20181101_Vectors_Loops.gh (Grasshopper 1.0.7)
# plug-ins: Anemone

number_slider = Slider(15, range=0..100)
number_slider_2 = Slider(27, range=0..100)
number_slider_3 = Slider(30, range=0..100)
c_script = CSharpScript(x=number_slider, y=number_slider_2)  # -> out, A, B; inputs x: Int32, y: Int32
# ---------- c_script: C# ----------
    System.Random rnd = new System.Random(y);
    //List <ball> balls = new List <ball>;//createBalls(x, rnd);
    List<Point3d> balls = new List<Point3d>();
    List<Vector3d> directions = new List<Vector3d>();
    for (int i = 0;i < x;i++){
      balls.Add(createPoint(rnd));
      directions.Add(createDirection(rnd));
    }
    A = balls;
    B = directions;
# ---------- c_script: C# additional code ----------
  public Point3d createPoint(System.Random rnd){
    Point3d point = new Point3d(rnd.NextDouble(), rnd.NextDouble(), 0);
    return point;
  }
  public Vector3d createDirection(System.Random rnd){
    Vector3d direction = Vector3d.XAxis;
    Vector3d z = Vector3d.ZAxis;
    direction.Rotate(rnd.NextDouble() * 2 * Math.PI, z);
    return direction;
  }
# ---------- end c_script ----------
c_script_2 = CSharpScript(x=number_slider, y=number_slider_2, z=number_slider_3)  # -> out, A, B, C; inputs x: Int32, y: Int32, z: Int32
# ---------- c_script_2: C# ----------
    System.Random rnd = new System.Random(y);
    //List <ball> balls = new List <ball>;//createBalls(x, rnd);
    List<Point3d> balls = new List<Point3d>();
    List<Point3d> newBalls = new List<Point3d>();
    List<Vector3d> directions = new List<Vector3d>();
    for (int i = 0;i < x;i++){
      balls.Add(createPoint(rnd));
      directions.Add(createDirection(rnd));
    }
    for(int i = 0;i < z;i++){
      for(int j = 0;j < x;j++){
        Vector3d zAxis = Vector3d.ZAxis;
        directions[j].Rotate(1, zAxis);//this should rotate the vector WHY NOT?
        balls[j] += directions[j];
        newBalls.Add(balls[j]);
      }
    }
    A = balls;
    B = directions;
    C = newBalls;
# ---------- c_script_2: C# additional code ----------
  public Point3d createPoint(System.Random rnd){
    Point3d point = new Point3d(rnd.NextDouble(), rnd.NextDouble(), 0);
    return point;
  }
  public Vector3d createDirection(System.Random rnd){
    Vector3d direction = Vector3d.XAxis;
    Vector3d z = Vector3d.ZAxis;
    direction.Rotate(rnd.NextDouble() * 2 * Math.PI, z);
    return direction;
  }
# ---------- end c_script_2 ----------
line = LineSDL(Start=c_script.A, Direction=c_script.B, Length=1)
panel = Panel(c_script_2.out)
loop_start = LoopStart(Repeat=number_slider_3, Trigger=Toggle(True), Data=c_script.B)  # -> port, Counter, Data
amp = Amplitude(Vector=c_script.B, Amplitude=loop_start.Counter)
loop_end = LoopEnd(port=loop_start.port, Exit=False, Data=amp, TimeOutVal=0, pausedState=False, state="Constant output")
move = Move(Geometry=c_script.A, Motion=loop_end)  # -> Geometry, Transform
