# Grasshopper definition 20181108_Agents.gh (Grasshopper 1.0.7)

pt = Point(Point(2.837239191, 7.018151496, 0))
timer = Timer(TimerInterval=50, Target=c_script)  # disabled
c_script = CSharpScript(AgentCount=Slider(5, range=0..10), Seed=Slider(287841, range=0..1000000), Food=pt, Run=Toggle(True))  # -> out, A; inputs AgentCount: Int32, Seed: Int32, Food: Point3d, Run: Boolean
# ---------- c_script: C# ----------
    if (Run) {
      if(counter == 0) {
        rnd = new System.Random(Seed);
        aquarium = CreateAquarium(AgentCount, rnd);
      }

      counter += 1;

      Point3d food = Food;
      List<Line> alllines = new List<Line>();

      for (int i = 0; i < aquarium.Count; i++){
        aquarium[i].Swim(food);
      }

      alllines.AddRange(DisplayAquarium(aquarium));
      A = alllines;
    }
    else{
      rnd = null;
      aquarium = null;
      counter = 0;
    }
# ---------- c_script: C# additional code ----------
  int counter = 0;

  //to create pseudo-random numbers
  System.Random rnd = null;

  //to store all instances of the Fish
  List<Fish> aquarium = null;

  public List<Line> DisplayAquarium(List<Fish> aquarium) {
    List<Line> lines = new List<Line>();
    for (int i = 0; i < aquarium.Count; i++)
    {
      lines.Add(aquarium[i].GetLine());
    }
    return lines;
  }

  public List<Fish> CreateAquarium(int AgentCount, System.Random rnd) {
    //create a new aquarium
    List<Fish> aquarium = new List<Fish>();

    //iterate until i is smaller than AgentCount.
    //exit the loop when i value gets equal or higher than AgentCount.
    for (int i = 0; i < AgentCount; i++)
    {
      //create random initial position using the rnd Random
      //Random is a a pseudo - random number generator
      Point3d position = new Point3d(rnd.NextDouble(),
        rnd.NextDouble(),
        rnd.NextDouble());

      //create random initial direction using the rnd Random
      Vector3d direction = new Vector3d(rnd.NextDouble(),
        rnd.NextDouble(),
        rnd.NextDouble());

      //create a fish using position and direction
      Fish myFish = new Fish(position, direction);

      //put the fish in the aquarium
      aquarium.Add(myFish);
    }

    return aquarium;
  }

  public class Fish {
    public Point3d Position = Point3d.Origin;
    public Vector3d Direction = Vector3d.XAxis;

    public Fish(Point3d InitialPosition, Vector3d InitialDirection){
      Position = InitialPosition;
      Direction = InitialDirection;
    }

    public void Swim() {
      Direction.Unitize();
      Position += Direction;
    }

    public void Swim(Point3d Food) {
      Direction.Unitize();
      Vector3d foodVector = Food - Position;
      foodVector.Unitize();
      Vector3d newDirection = Direction + foodVector;
      newDirection.Unitize();
      Direction = newDirection;
      Position += Direction;
    }

    public Line GetLine() {
      Line line = new Line(Position, Direction, 1);
      return line;
    }

  }
# ---------- end c_script ----------
panel = Panel(c_script.A)
