# Grasshopper definition 20181108_Permutation.gh (Grasshopper 1.0.7)

c_script = CSharpScript()  # -> out, A
# ---------- c_script: C# ----------
    int[] values = new int[6];
    values[0] = 0; 
    values[1] = 1; 
    values[2] = 2; 
    values[3] = 3; 
    values[4] = 4; 
    values[5] = 5; 
    
    A = GetCombinations(values, 1000);
# ---------- c_script: C# additional code ----------
  public List<int[]> GetCombinations(int[] Values, int maxCount){
    int n = Values.Length; 
    int[] c = new int[n]; 
    List<int[]> combinations = new List<int[]>(); 
    
    AddCopy(Values, combinations); 
    
    int i = 0; 
    
    while (i < n)
    {
      if (c[i] < i) {
        if((i % 2) == 0) Swap(Values, 0, i); 
        else  Swap(Values, c[i], i); 
        
        if (AddCopy(Values, combinations) >= maxCount) {
          return combinations; 
        }
        
        c[i] += 1; 
        i = 0; 
      }
      else{
        c[i] = 0; 
        i++; 
      }
    }
    return combinations; 
  }
  
  public void Swap(int[] Values, int A, int B){
    int ac = Values[A]; //stores the value of A 
    Values[A] = Values[B]; 
    Values[B] = ac; 
  }
  
  public int AddCopy(int[] Values, List<int[]> Permutations){
    int[] copy = new int[Values.Length]; 
    Array.Copy(Values, copy, Values.Length); 
    Permutations.Add(copy);
    return Permutations.Count; 
  }
# ---------- end c_script ----------
c_script_2 = CSharpScript(ElementCount=Slider(6, range=0..10))  # -> out, A; inputs ElementCount: Int32
# ---------- c_script_2: C# ----------
    int combinations = (int) Math.Pow(2, ElementCount);
    List<string> values = new List<string>();

    int maxLength = Convert.ToString(combinations - 1, 2).Length;
    Print(maxLength.ToString());


    for (int i = 0; i < combinations; i++)
    {
      string val = Convert.ToString(i, 2);
      int length = val.Length;
      int zeroes = maxLength - length; //number of zeroes to prepend
      string prefix = new string('0', zeroes);

      values.Add(prefix + val);
    }



    A = values;
# ---------- end c_script_2 ----------
lng = ListLength(List=c_script.A)
c_script_3 = CSharpScript(x=c_script.A)  # -> out, A
# ---------- c_script_3: C# ----------
    A = x;
# ---------- end c_script_3 ----------
series = Series(Start=0, Step=Slider(3, range=0..10), Count=lng)
c_script_4 = CSharpScript(x=c_script_2.A)  # -> out, A; inputs x: String
# ---------- c_script_4: C# ----------
    List<bool> values = new List<bool>(); 
    foreach (char item in x)
    {
      if (item =='1')
      {
        values.Add(true); 		 
      }   
      else {
      values.Add(false); 
      }
    }
    
    A = values;
# ---------- end c_script_4 ----------
pt = ConstructPoint(XCoordinate=series, YCoordinate=0, ZCoordinate=0)
box = CenterBox(Base=pt, X=1, Y=1, Z=1)
panel = Panel(c_script_4.A)
mbox = MeshBox(Base=box, XCount="1", YCount="1", ZCount="1")
facen = FaceNormals(Mesh=mbox)  # -> Centers, Normals
item = ListItem(List=facen.Centers, Index=c_script_3.A, Wrap=True)
pline = PolyLine(Vertices=item, Closed=False)
