# Grasshopper definition 20181108_Recursion.gh (Grasshopper 1.0.7)

polygon = Polygon(Plane=PlaneXY(0, 0, 0), Radius=3, Segments=Slider(5, range=0..10), FilletRadius=0)  # -> Polygon, Length
flip = FlipCurve(Curve=polygon.Polygon)  # -> Curve, Flag
explode = Explode(Curve=flip.Curve, Recursive=True)  # -> Segments, Vertices
recursive = CSharpScript(x=explode.Segments)  # -> out, A; inputs x: list of Line
# ---------- recursive: C# ----------
    List<Line> results = new List<Line>();

    foreach (Line line in x)
    {
      results.AddRange(Subdivide(line, 4));
    }

    A = results;
# ---------- recursive: C# additional code ----------
  List<Line> Subdivide(Line line, int Counter){
    Counter -= 1;

   if(Counter == 0) {
      return new List<Line>(); //empty list
    }

    Point3d pA = line.PointAt(0);
    Point3d pB = line.PointAt(1.0 / 3.0);
    Point3d pC = line.PointAt(1.0 / 3.0);
    Point3d pD = line.PointAt(2.0 / 3.0);
    Point3d pE = line.PointAt(1);

    Vector3d PeakVector = pD - pB;
    PeakVector.Rotate(Math.PI / 3.0, Vector3d.ZAxis);
    pC += PeakVector;

    Polyline pline = new Polyline();
    pline.Add(pA);
    pline.Add(pB);
    pline.Add(pC);
    pline.Add(pD);
    pline.Add(pE);

    List<Line> results = new List<Line>(pline.GetSegments());
    List<Line> subdivres = new List<Line>();

    foreach (Line subdivision in results)
    {
      subdivres.AddRange(Subdivide(subdivision, Counter));
    }
 
    if (subdivres.Count == 0) return results;
    return subdivres;
  }
# ---------- end recursive ----------
iterative = CSharpScript(x=explode.Segments)  # -> out, A; inputs x: list of Line
# ---------- iterative: C# ----------
    List<Line> results = new List<Line>();

    for (int i = 0; i < 3; i++)
    {
      foreach (Line line in x)
      {
        results.AddRange(Subdivide(line));
      }

      x.Clear();
      x.AddRange(results);
      results.Clear();
    }


    A = x;
# ---------- iterative: C# additional code ----------
  List<Line> Subdivide(Line line){
    Point3d pA = line.PointAt(0);
    Point3d pB = line.PointAt(1.0 / 3.0);
    Point3d pC = line.PointAt(1.0 / 3.0);
    Point3d pD = line.PointAt(2.0 / 3.0);
    Point3d pE = line.PointAt(1);

    Vector3d PeakVector = pD - pB;
    PeakVector.Rotate(Math.PI / 3.0, Vector3d.ZAxis);
    pC += PeakVector;

    Polyline pline = new Polyline();
    pline.Add(pA);
    pline.Add(pB);
    pline.Add(pC);
    pline.Add(pD);
    pline.Add(pE);

    return new List<Line>(pline.GetSegments());
  }
# ---------- end iterative ----------
