# Grasshopper definition 20181129_CurveOffset.gh (Grasshopper 1.0.7)

geometry = Geometry(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)
flip_curve = FlipCurve(Curve=geometry)  # -> Curve, Flag
range = Range(Domain=Slider(5, range=0..10), Steps=Slider(7, range=1..11))
stream_filter = StreamFilter(Gate=Toggle(True), Stream0=geometry, Stream1=flip_curve.Curve)
panel = Panel(range)
offset_curve = OffsetCurve(Curve=stream_filter, Distance=range, Plane=PlaneXY(0, 0, 0), Corners=1)
flatten_tree = FlattenTree(Tree=offset_curve, Path="{0}")
dispatch = Dispatch(List=flatten_tree, DispatchPattern=[True, False])  # -> ListA, ListB
number_slider = Slider(100, range=0..100)
geometry_2 = Geometry(dispatch.ListB)
geometry_3 = Geometry(dispatch.ListA)
end_points = EndPoints(Curve=geometry_3)  # -> Start, End
extend_curve = ExtendCurve(Curve=geometry_2, Type=0, Start=number_slider, End=number_slider)
c_script = CSharpScript(x=geometry_2)  # -> out, A; inputs x: Curve
# ---------- c_script: C# ----------
    Curve offset = x.Extend(CurveEnd.Both, 100, CurveExtensionStyle.Smooth);
    A = offset;
# ---------- end c_script ----------
line = Line(StartPoint=end_points.Start, EndPoint=end_points.End)
curve_line = CurveLine(Curve=extend_curve, Line=line)  # -> Points, Params, Count
graft_tree = GraftTree(Tree=extend_curve, IncludeEmptyLists=True, IncludeNullItems=True)
shatter = Shatter(Curve=graft_tree, Parameters=curve_line.Params)
list_item = ListItem(List=shatter, Index="1", Wrap=True)
flatten_tree_2 = FlattenTree(Tree=list_item, Path="{0}")
geometry_4 = Geometry(geometry_3)
geometry_5 = Geometry(flatten_tree_2)
end_points_2 = EndPoints(Curve=geometry_5)  # -> Start, End
end_points_3 = EndPoints(Curve=geometry_4)  # -> Start, End
line_2 = Line(StartPoint=end_points_3.Start, EndPoint=end_points_2.Start)
line_3 = Line(StartPoint=end_points_3.End, EndPoint=end_points_2.End)
graft_tree_2 = GraftTree(Tree=geometry_4, IncludeEmptyLists=True, IncludeNullItems=True)
graft_tree_3 = GraftTree(Tree=geometry_5, IncludeEmptyLists=True, IncludeNullItems=True)
graft_tree_4 = GraftTree(Tree=line_2, IncludeEmptyLists=True, IncludeNullItems=True)
graft_tree_5 = GraftTree(Tree=line_3, IncludeEmptyLists=True, IncludeNullItems=True)
merge = Merge(Data1=graft_tree_2, Data2=graft_tree_4, Data3=graft_tree_5, Data4=graft_tree_3)
join_curves = JoinCurves(Curves=merge, Preserve=False)
flatten_tree_3 = FlattenTree(Tree=join_curves, Path="{0}")
