# Grasshopper definition 20181129_MeshClash.gh (Grasshopper 1.0.7)

geometry = Geometry(<mesh referenced from the Rhino model>)
geometry_2 = Geometry(<mesh referenced from the Rhino model>)
c_script = CSharpScript(x=geometry_2, y=geometry)  # -> out, A, B; inputs x: Mesh, y: Mesh
# ---------- c_script: C# ----------
    List<Mesh> listA = new List<Mesh>();
    List<Mesh> listB = new List<Mesh>();

    listA.Add(x);
    listB.Add(y);

    A = Rhino.Geometry.Intersect.MeshClash.Search(listA, listB, 0.1, 1);

    B = null;
# ---------- end c_script ----------
panel = Panel(c_script.A)
panel_2 = Panel(c_script.B)
