# Grasshopper definition 20181129_SheetFolding.gh (Grasshopper 1.0.7)

geometry = Geometry(<curve referenced from the Rhino model>)
explode = Explode(Curve=geometry, Recursive=True)  # -> Segments, Vertices
list_item = ListItem(List=explode.Segments, Index=0, Wrap=True)  # -> Item, Item1, Item2
c_script = CSharpScript(x=list_item.Item)  # -> out, A; inputs x: Curve
# ---------- c_script: C# ----------
      double[] param = x.DivideByCount(10, true);

    List<Point3d> points = new List<Point3d>();
    
    foreach (double item in param)
    {
      points.Add(x.PointAt(item)); 
    }
    
    A = points;
# ---------- end c_script ----------
c_script_2 = CSharpScript(x=list_item.Item2)  # -> out, A; inputs x: Curve; same code as c_script
c_script_3 = CSharpScript(x=c_script.A, y=c_script_2.A)  # -> out, A; inputs x: list of Point3d, y: list of Point3d
# ---------- c_script_3: C# ----------
    List<Line> lines = new List<Line>();

    for (int i = 0; i < x.Count; i++)
    {
      lines.Add(new Line(x[i], y[i]));
    }

    A = lines;

    
    //Rhino.Geometry.Intersect.Intersection.lineline
# ---------- end c_script_3 ----------
