# Grasshopper definition 20180426_Hyperboloid_PY.gh (Grasshopper 1.0.5)

r1 = Slider(2.858, range=0..10)
r2 = Slider(3.161, range=0..10)
pt = ConstructPoint(XCoordinate=0, YCoordinate=0, ZCoordinate=Slider(5.339, range=0..10))
python = GhPythonScript(
    r1=Slider(1.767, range=0..10),
    r2=Slider(1.415, range=0..10),
    h=Slider(3.705, range=0..10),
    angle=Slider(2.147, range=0..6),
    count=Slider(32, range=0..100))  # -> out, hb, lines; inputs count: Int32
# ---------- python: Python ----------
__author__ = "Mateusz"
__version__ = "2018.04.26"

import rhinoscriptsyntax as rs
import Rhino.Geometry as rg
import System.Math as math 

circle1 = rg.Circle(r1)
circle2 = rg.Circle(rg.Point3d(0,0,h), r2)

circle2.Rotate(angle, rg.Vector3d.ZAxis)

list1 = []
list2 = []

for i in range(count):
    list1.append(circle1.PointAt(i/count * math.PI * 2))
    list2.append(circle2.PointAt(i/count * math.PI * 2))

lines = []

for i in range(len(list1)):
    lines.append(rg.Line(list1[i], list2[i]).ToNurbsCurve())

hb = rg.Brep.CreateFromLoft (lines,rg.Point3d.Unset,rg.Point3d.Unset,rg.LoftType.Normal, True)
# ---------- end python ----------
number_slider = Slider(32, range=0..100)
cir = Circle(Plane=pt, Radius=r2)
cir_2 = Circle(Plane=PlaneXY(0, 0, 0), Radius=r1)
rotate = Rotate(Geometry=cir, Angle=Slider(1.862, range=0..6), Plane=PlaneXY(0, 0, 0))  # -> Geometry, Transform
panel = Panel(python.hb)
divide = DivideCurve(Curve=rotate.Geometry, Count=number_slider, Kinks=False)  # -> Points, Tangents, Parameters
divide_2 = DivideCurve(Curve=cir_2, Count=number_slider, Kinks=False)  # -> Points, Tangents, Parameters
ln = Line(StartPoint=divide_2.Points, EndPoint=divide.Points)
loft = Loft(Curves=ln, Options={Adjust=False, Closed=True, LoftEnds=0, LoftSimp=0, LoftType=0, Rebuild=10, Refit=0.01})
