# Grasshopper definition 20180517_Point Eater.gh (Grasshopper 1.0.5)
# plug-ins: Anemone

pop2d = Populate2D(
    Region={Plane=PlaneXY(14.71504878, 7.770756693, 0), Size=Domain2(u=-38.37008925..38.37008925, v=-37.41225095..37.41225095)},
    Count=Slider(200, range=0..10000),
    Seed=1)
pline = PolyLine(Vertices=[Point(-20.48551488, 36.18920668, 0), Point(88.22399386, 27.91252502, 0)], Closed=False)

# ---- group: "saved" in sticky
number_slider = Slider(554, range=0..1000)

# ----
loop_start = LoopStart(Repeat=Slider(328, range=0..1000))  # -> port, Counter, Data
timer = Timer(TimerInterval=1000, Target=python)
panel = Panel(loop_start.Data)
python = GhPythonScript(run=Toggle(False), y=Slider(1, range=0..100))  # -> out, a, b
# ---------- python: Python ----------
__author__ = "Mateusz"
__version__ = "2018.05.17"

import rhinoscriptsyntax as rs
import Rhino.Geometry as rg 
import scriptcontext as sc 

#if the script is not running then reset the point location
if not (run):
    point = rg.Point3d(0,0,0)
    sc.sticky["point"] = point #add the point to the sticky
else :
    #if the sticky has the point then get it (last location)
    if (sc.sticky.ContainsKey("point")):
        point = sc.sticky["point"]
    else: #if the sticky misses the "point" then create it
        point = rg.Point3d(0,0,0)
        sc.sticky["point"] = point
        
    #finally move the point
    point.Transform(rg.Transform.Translation(0,0,y))

a = point
# ---------- end python ----------
addition = Addition(A=number_slider, B=loop_start.Data)
loop_end = LoopEnd(port=loop_start.port, Exit=False, Data=addition, TimeOutVal=0, pausedState=False, state="Constant output")

loop_start_2 = LoopStart(N=Slider(1000, range=0..1000), D0=pline, D1=pop2d)  # -> port, Counter, Data, Data_2

python_2 = GhPythonScript(poly=loop_start_2.Data, point=loop_start_2.Data_2)  # -> out, a, b; inputs poly: Polyline, point: list of Point3d
# ---------- python_2: Python ----------
__author__ = "Mateusz"
__version__ = "2018.05.17"

import System as sys 
import rhinoscriptsyntax as rs
import System.Math as math 
import Grasshopper.Kernel.Types as ght 

distValue = sys.Double.MaxValue
distIdx = -1 

for i in range(0, point.Count):
    cp = poly.ClosestPoint(point[i])
    dist = cp.DistanceTo(point[i])
    if (dist < distValue): 
        distValue = dist 
        distIdx = i

outputpoint = point[distIdx]
point.RemoveAt(distIdx)

a = outputpoint
b = point
# ---------- end python_2 ----------
smoothing = Slider(0.0401, range=0..1)
python_3 = GhPythonScript(poly=loop_start_2.Data, point=python_2.a)  # -> out, a; inputs poly: Polyline, point: Point3d
# ---------- python_3: Python ----------
__author__ = "Mateusz"
__version__ = "2018.05.17"

import rhinoscriptsyntax as rs
import System.Math as math 
import Grasshopper.Kernel.Types as ght 

param = poly.ClosestParameter(point)
intPart = math.Floor(param)
poly.Insert(intPart+1, point) 


#wrap polyline into gh_curve type to prevent
#the param from enumerating the points
a = ght.GH_Curve(poly.ToNurbsCurve())
# ---------- end python_3 ----------
python_4 = GhPythonScript(poly=python_3.a, smoothing=smoothing)  # -> out, a; inputs poly: Polyline
# ---------- python_4: Python ----------
__author__ = "Mateusz"
__version__ = "2018.05.17"

import rhinoscriptsyntax as rs
import System.Math as math 
import Grasshopper.Kernel.Types as ght 
import Rhino.Geometry as rg 

#duplicates the old polyline
duppoly = rg.Polyline(poly)

#affect only the internal points 
for i in range(1, poly.Count-1):
    #get the local points
    prevpoint = poly[i-1]
    thispoint = poly[i]
    nextpoint = poly[i+1]
    
    #find middle point
    midpoint = (prevpoint + nextpoint) / 2 
    duppoly[i] = thispoint + ((midpoint - thispoint) * smoothing)

a = duppoly
# ---------- end python_4 ----------
pline_2 = PolyLine(Vertices=python_4.a, Closed=False)

running = Running(
    port=loop_start_2.port,
    Exit=False,
    Data=pline_2,
    Data_2=python_2.b,
    TimeOutVal=0,
    pausedState=False,
    state="Constant output")  # -> D0, D1
