# Grasshopper definition find_lowest_line_PY.gh (Grasshopper 1.0.5)

brep = Brep(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)
python = GhPythonScript(box=brep)  # -> out, a
# ---------- python: Python ----------
"""Provides a scripting component.
    Inputs:
        box: internalized Box from Rhino
        y: The y script variable
    Output:
        a: The a output variable"""

__author__ = "vukorep"
__version__ = "2018.05.03"

import rhinoscriptsyntax as rs
import random

def findLowestLine(face):
    #DuplicateSurface is making one continous countur
    #therefore we have to explode the curve in separate face edges
    edges=rs.ExplodeCurves(rs.DuplicateSurfaceBorder(face))
    sumZ=[] #declaring a empty list of variables 
    for line in edges: #iterating trough every single edge
        #collecting the Z of start and end point of each line into the sumZ list
        sumZ.append(rs.CurveStartPoint(line)[2]+rs.CurveEndPoint(line)[2])
    #check if the neighboring lines are on the same Z
    if sumZ[0]==sumZ[1]:
        #if yes: then return nothing
        return None
    else:
        #of no: return the edge with the lowest value
        #min(sumZ)-> lowest value in the list
        #sumZ.index(lowest value)-> return the index-number of this value
        return edges[sumZ.index(min(sumZ))]
expl=rs.ExplodePolysurfaces(box)
random.shuffle(expl)#this gives us a random face
lowestLine=findLowestLine(expl[0])
if lowestLine:
    #put the result to output a
    a=rs.CurveMidPoint(lowestLine)
# ---------- end python ----------
panel = Panel(python.a)
